# Grasshopper definition Klepper_2.ghx (Grasshopper 1.0.7)
# plug-ins: Heteroptera, treesloth01, Pufferfish, Human, Kangaroo2 Components, Wombat

panel = Panel("Boat Parameters")
unit_warning = UnitWarning(UnitSystem=8)
panel_2 = Panel("Boat Dimensions")
panel_3 = Panel("CNC Template")
panel_4 = Panel("Rib Spacing")
construct_point = ConstructPoint(XCoordinate=0, YCoordinate=0, ZCoordinate=0)
construct_point_2 = ConstructPoint(XCoordinate=0, YCoordinate=0, ZCoordinate=0)
section_y_location = Integer(-144)
panel_5 = Panel("Hull")
panel_6 = Panel("Deck")
panel_7 = Panel("Cockpit")
plane = Plane(PlaneYZ(0, 0, 0))
panel_8 = Panel("Bow & Stern")

forward_cockpit_curvature = Slider(8, range=0..10)
rear_cockpit_curvature = Slider(20, range=0..20, expression="x/2")
cockpit_back_curvature = Slider(13, range=0..20, expression="x/2")
length = Slider(14, range=6..20)
rib_spacing_factor = Slider(0.6, range=0..1)
bow_vertical_curviture_direction = Slider(14, range=0..16, expression="x/16")
bow_vertical_curviture_magnitude = Slider(15.7, range=0..24, expression="x/4")
bow_vertical_curviture_magnitude_2 = Slider(20, range=0..24)
hull_min_horizontal_curve = Slider(4, range=2..16, expression="x/4")
hull_horizontal_curviture = Slider(6, range=0..128)
deck_logitudinal_peak = Slider(24, range=6..24)
cockpit_front_curvature = Slider(11, range=0..20, expression="x/2")
longitudinal_beam_factor = Slider(1, range=0..1)
beam = Slider(23.91, range=16..72)
bow_width_factor = Slider(0.357, range=0..1)
stern_width_factor = Slider(0.656, range=0..1)
total_boat_height = Slider(24, range=16..40, expression="X/2")
hull_height = Slider(16, range=0..36, expression="x/2")
hull_vertical_curviture = Slider(16.4, range=0..24, expression="x/4")
stern_vertical_curviture_direction = Slider(9, range=0..16, expression="x/16")
stern_vertical_curviture_magnitude = Slider(10, range=0..12)
stern_vertical_curviture_magnitude_2 = Slider(17.1, range=0..24, expression="x/4")
deck_horizontal_curviture = Slider(1, range=0..1)
deck_vertical_curviture = Slider(8, range=0..32, expression="x/16")
cockpit_longitudinal_start = Slider(3, range=0..12)
cockpit_width_x = Slider(5, range=0..12)
cockpit_width = Slider(0.692, range=0..1)
cockpit_length = Slider(0.363, range=0..1)

X = Multiplication(A=length, B=12)
division = Division(A=X, B=4)
construct_domain = ConstructDomain(DomainStart=expr("-x/2", division), DomainEnd=expr("x/2", division))
slide_within_domain = SlideWithinDomain(Domain=construct_domain, Factor=longitudinal_beam_factor)
division_2 = Division(A=beam, B=2)
construct_domain_2 = ConstructDomain(DomainStart="6", DomainEnd=division_2)
construct_domain_3 = ConstructDomain(DomainStart="6", DomainEnd=division_2)
slide_within_domain_2 = SlideWithinDomain(Domain=construct_domain_2, Factor=stern_width_factor)
slide_within_domain_3 = SlideWithinDomain(Domain=construct_domain_3, Factor=bow_width_factor)
construct_point_3 = ConstructPoint(XCoordinate=expr("x/2", X), YCoordinate=0, ZCoordinate=0)
construct_point_4 = ConstructPoint(XCoordinate=expr("-x/2", X), YCoordinate=0, ZCoordinate=0)
construct_point_5 = ConstructPoint(XCoordinate=slide_within_domain, YCoordinate=expr("-x", division_2), ZCoordinate=0)
construct_point_6 = ConstructPoint(XCoordinate=expr("-x", division), YCoordinate=slide_within_domain_3, ZCoordinate=0)
construct_point_7 = ConstructPoint(XCoordinate=expr("-x", division), YCoordinate=expr("-x", slide_within_domain_3), ZCoordinate=0)
construct_point_8 = ConstructPoint(XCoordinate=division, YCoordinate=expr("-x", slide_within_domain_2), ZCoordinate=0)
construct_point_9 = ConstructPoint(XCoordinate=slide_within_domain, YCoordinate=division_2, ZCoordinate=0)
construct_point_10 = ConstructPoint(XCoordinate=division, YCoordinate=slide_within_domain_2, ZCoordinate=0)

bow_length = Slider(24, range=4..24)
stern_length = Slider(12, range=2..16)
keel_line = Line(StartPoint=construct_point_3, EndPoint=construct_point_4)
subdivide = Subdivide(bow=bow_length, stern=stern_length, curve=keel_line)  # -> start, end
construct_domain_4 = ConstructDomain(DomainStart=subdivide.start, DomainEnd=subdivide.end)
sub_curve = SubCurve(BaseCurve=keel_line, Domain=construct_domain_4)
length_2 = Length(Curve=sub_curve)
series = Series(Start=1, Step=1, Count="100")
modulus = Modulus(A=length_2, B=series)  # -> graft(Result)
equality = Equality(FirstNumber=modulus, SecondNumber=0)  # -> flatten(Equality), Inequality
cull_pattern = CullPattern(List=series, CullPattern=equality.Equality)
list_length = ListLength(List=cull_pattern)
custom_int_domain = CustomIntDomain(value=rib_spacing_factor, domain_start="0", domain_end=expr("x-1", list_length))
list_item = ListItem(List=cull_pattern, Index=custom_int_domain, Wrap=True)
python_moduls = GhPythonScript(Rib=list_item, CurveLength=length_2)  # -> Count, a
# ---------- python_moduls: Python ----------
__author__ = "Keaton Nemes"
__version__ = "2023.07.10"

import rhinoscriptsyntax as rs

if CurveLength%Rib == 0:
    Count = CurveLength/Rib
    print(Count)
else:
    Count = 1 
    print(Count)
# ---------- end python_moduls ----------
divide_curve = DivideCurve(Curve=sub_curve, Count=python_moduls.Count, Kinks=False)  # -> Points, Tangents, Parameters
rib_points = SortPoints(Points=divide_curve.Points)  # -> flatten(Points), Indices

merge = Merge(
    Data1=construct_point_3,
    Data2=construct_point_10,
    Data3=construct_point_9,
    Data4=construct_point_6,
    Data5=construct_point_4)
merge_2 = Merge(
    Data1=construct_point_3,
    Data2=construct_point_8,
    Data3=construct_point_5,
    Data4=construct_point_7,
    Data6=construct_point_4)
stack_trees = StackTrees(Data0=merge, Data1=merge_2, Reduce=True)
interpolate = Interpolate(Vertices=stack_trees, Degree=3, Periodic=False, KnotStyle=1)  # -> Curve, Length, Domain
vector_xyz = VectorXYZ(XComponent=0, YComponent=0, ZComponent=hull_height)  # -> Vector, Length
cluster = Cluster(curve_b=interpolate.Curve, geometry=interpolate.Curve)  # -> beam_x_coordinate_2, beam_2, points
move = Move(Geometry=interpolate.Curve, Motion=vector_xyz.Vector)  # -> Geometry, Transform
flatten_tree = FlattenTree(Tree=cluster.points, Path="{0}")
split_list = SplitList(List=flatten_tree, Index=1)  # -> ListA, ListB
line = Line(StartPoint=split_list.ListA, EndPoint=split_list.ListB)
vector_xyz_2 = VectorXYZ(XComponent=0, YComponent=0, ZComponent=expr("x*1.25", total_boat_height))  # -> Vector, Length
beam_line = Curve(line)
extrude = Extrude(Base=beam_line, Direction=vector_xyz_2.Vector)
curve_middle = CurveMiddle(Curve=beam_line)
first_last = FirstLast(List=rib_points.Points)  # -> FirstValue, LastValue
construct_domain_5 = ConstructDomain(DomainStart=subdivide.end, DomainEnd=1)
construct_domain_6 = ConstructDomain(DomainStart=0, DomainEnd=subdivide.start)
sub_curve_2 = SubCurve(BaseCurve=keel_line, Domain=construct_domain_5)
sub_curve_3 = SubCurve(BaseCurve=keel_line, Domain=construct_domain_6)
length_3 = Length(Curve=sub_curve_2)
length_4 = Length(Curve=sub_curve_3)
construct_point_11 = ConstructPoint(XCoordinate=expr("-x", length_4), YCoordinate=hull_height, ZCoordinate=0)
construct_point_12 = ConstructPoint(XCoordinate=length_3, YCoordinate=hull_height, ZCoordinate=0)
rectangle_2pt = Rectangle2Pt(Plane=PlaneXY(0, 0, 0), PointA=construct_point, PointB=construct_point_12, Radius=0)  # -> Rectangle, Length
rectangle_2pt_2 = Rectangle2Pt(Plane=PlaneXY(0, 0, 0), PointA=construct_point_2, PointB=construct_point_11, Radius=0)  # -> Rectangle, Length
merge_3 = Merge(Data1=rectangle_2pt.Rectangle, Data2=rectangle_2pt_2.Rectangle)
list_length_2 = ListLength(List=rib_points.Points)  # -> expr("x+2", Length)
construct_domain_7 = ConstructDomain(DomainStart=1, DomainEnd=expr("x-2", list_length_2))
series_2 = Series(Start=0, Step=50, Count=list_length_2)
construct_point_13 = ConstructPoint(XCoordinate=series_2, YCoordinate=section_y_location, ZCoordinate=0)  # -> simplify(SectionOrigin)
deck_reference = DeckReference(A=cluster.beam_2, y_coordinate_2=total_boat_height, y_coordinate=hull_height)
hull_reference = HullReference(A=cluster.beam_2, y_coordinate=hull_height)
sub_list = SubList(List=construct_point_13, Domain=construct_domain_7, Wrap=True)  # -> simplify(List), Index
first_last_2 = FirstLast(List=construct_point_13)  # -> FirstValue, LastValue
reference_box = Move(Geometry=graft([hull_reference, deck_reference]), Motion=sub_list.List)  # -> simplify(Geometry), Transform
reference_box_2 = Move(Geometry=merge_3, Motion=[first_last_2.FirstValue, first_last_2.LastValue])  # -> simplify(Geometry), Transform
plane_origin = PlaneOrigin(Base=plane, Origin=sub_list.List)

move_to_point = MoveToPoint(Geometry=extrude, PointA=curve_middle, PointB=rib_points.Points)  # -> Moved, Vector, Transform
brep_curve = BrepCurve(Brep=move_to_point.Moved, Curve=move.Geometry)  # -> Curves, flatten(Points)
ribs_python = GhPythonScript(KeelPoints=rib_points.Points, GunwalePoints=brep_curve.Points)  # -> Out, simplify(Points), Distance; inputs KeelPoints: list of Point3d, GunwalePoints: list of Point3d
# ---------- ribs_python: Python ----------
__author__ = "Keaton Nemes"
__version__ = "2023.07.10"

import rhinoscriptsyntax as rs
import ghpythonlib.treehelpers as th
import scriptcontext as sc
import Rhino


KeelLen = len(KeelPoints)
GunwLen = len(GunwalePoints)

RibPoints = []
KGDistance = []

for i in range(KeelLen):
    PointLst = []
    PointLst.insert(1,KeelPoints[i])
    for j in range(GunwLen):
        if round(KeelPoints[i][0]) == round(GunwalePoints[j][0]):
            if (GunwalePoints[j][1] < 0):
                PointLst.insert(0,GunwalePoints[j])
    RibPoints.append(PointLst)
    KGDistance.append([PointLst[0].DistanceTo(PointLst[1])])



RibTree = th.list_to_tree(RibPoints)
Points = RibTree

DisTree = th.list_to_tree(KGDistance)
Distance = DisTree
# ---------- end ribs_python ----------
panel_9 = Panel(ribs_python.Points)
panel_10 = Panel(ribs_python.Distance)
list_item_2 = ListItem(List=ribs_python.Points, Index=1, Wrap=True)
transform = Transform(geometry=ribs_python.Points, center=list_item_2, point_b=sub_list.List)
geometry = Geometry(transform)
project = Project(Geometry=geometry, Plane=PlaneXY(0, 0, 0))  # -> Geometry, Transform
split_list_2 = SplitList(List=project.Geometry, Index=1)  # -> simplify(ListA), simplify(ListB)
mirror = Mirror(Geometry=split_list_2.ListA, Plane=graft(plane_origin))  # -> simplify(Geometry), Transform
min_max = MinMax(Number=flatten(ribs_python.Distance))  # -> Minimum, Maximum
unit_y = UnitY(Factor=1)
subtraction = Subtraction(A=split_list_2.ListA, B=unit_y)
division_3 = Division(A=ribs_python.Distance, B=min_max.Minimum)  # -> simplify(Result)
subtraction_2 = Subtraction(A=division_3, B=1)
vector_2pt = Vector2Pt(PointA=split_list_2.ListA, PointB=split_list_2.ListB, Unitize=True)  # -> Vector, Length
vector_2pt_2 = Vector2Pt(PointA=split_list_2.ListA, PointB=subtraction, Unitize=False)  # -> Vector, Length
min_max_2 = MinMax(Number=flatten(subtraction_2))  # -> Minimum, Maximum
multiplication = Multiplication(A=hull_horizontal_curviture, B=division_3)
min_max_3 = MinMax(Number=flatten(multiplication))  # -> Minimum, Maximum
angle = Angle(VectorA=vector_2pt.Vector, VectorB=vector_2pt_2.Vector)  # -> Angle, Reflex
construct_domain_8 = ConstructDomain(DomainStart=min_max_2.Minimum, DomainEnd=min_max_2.Maximum)
min_max_4 = MinMax(Number=flatten(angle.Angle))  # -> Minimum, Maximum
construct_domain_9 = ConstructDomain(DomainStart=hull_min_horizontal_curve, DomainEnd=min_max_3.Maximum)
construct_domain_10 = ConstructDomain(DomainStart=min_max_3.Minimum, DomainEnd=min_max_3.Maximum)
remap_numbers = RemapNumbers(Value=subtraction_2, Source=construct_domain_8, Target=Domain(0, 1))  # -> simplify(Mapped), Clipped
domain_percentage = DomainPercentage(domain_end=min_max_4.Maximum, value=remap_numbers.Mapped, domain_start="0")
remap_numbers_2 = RemapNumbers(Value=multiplication, Source=construct_domain_10, Target=construct_domain_9)  # -> simplify(Mapped), Clipped
unit_z = UnitZ(Factor=1)
rotate = Rotate(Vector=vector_2pt.Vector, Axis=unit_z, Angle=domain_percentage)
unit_x = UnitX(Factor=remap_numbers_2.Mapped)
unit_vector = UnitVector(Vector=rotate)
multiplication_2 = Multiplication(A=unit_vector, B=hull_vertical_curviture)
bezier_span = BezierSpan(StartPoint=split_list_2.ListA, StartTangent=multiplication_2, EndPoint=split_list_2.ListB, EndTangent=unit_x)  # -> Curve, Length, Domain
mirror_2 = Mirror(Geometry=bezier_span.Curve, Plane=graft(plane_origin))  # -> simplify(Geometry), Transform
join_curves = JoinCurves(Curves=[bezier_span.Curve, mirror_2.Geometry], Preserve=False)  # -> simplify(Curves)
ribs = Ribs(center=list_item_2, geometry=join_curves, point_a=sub_list.List, point_b=list_item_2)
curve = Curve(ribs)

vector_xyz_3 = VectorXYZ(XComponent=expr("-x", deck_logitudinal_peak), YComponent=0, ZComponent=total_boat_height)  # -> Vector, Length
move_2 = Move(Geometry=[construct_point_3, construct_point_4], Motion=vector_xyz.Vector)  # -> Geometry, Transform
peak = Move(Geometry=curve_middle, Motion=vector_xyz_3.Vector)  # -> Geometry, Transform
split_list_3 = SplitList(List=move_2.Geometry, Index=1)  # -> ListA, ListB
merge_4 = Merge(Data1=split_list_3.ListA, Data2=peak.Geometry, Data3=split_list_3.ListB)
interpolate_2 = Interpolate(Vertices=merge_4, Degree=3, Periodic=False, KnotStyle=1)  # -> flatten(Curve), Length, Domain
brep_curve_2 = BrepCurve(Brep=move_to_point.Moved, Curve=interpolate_2.Curve)  # -> Curves, flatten(Points)
deck_python = GhPythonScript(DeckPoints=brep_curve_2.Points, GunwalePoints=brep_curve.Points)  # -> Out, simplify(Points), Distance; inputs DeckPoints: list of Point3d, GunwalePoints: list of Point3d
# ---------- deck_python: Python ----------
__author__ = "Keaton Nemes"
__version__ = "2023.07.10"

import rhinoscriptsyntax as rs
import ghpythonlib.treehelpers as th
import scriptcontext as sc
import Rhino


DeckLen = len(DeckPoints)
GunwLen = len(GunwalePoints)

RibPoints = []
KGDistance = []

for i in range(DeckLen):
    PointLst = []
    PointLst.insert(1,DeckPoints[i])
    for j in range(GunwLen):
        if round(DeckPoints[i][0]) == round(GunwalePoints[j][0]):
            if (GunwalePoints[j][1] < 0):
                PointLst.insert(0,GunwalePoints[j])
    RibPoints.append(PointLst)
    KGDistance.append([PointLst[0].DistanceTo(PointLst[1])])



RibTree = th.list_to_tree(RibPoints)
Points = RibTree

DisTree = th.list_to_tree(KGDistance)
Distance = DisTree
# ---------- end deck_python ----------
transform_2 = Transform(geometry=graft(brep_curve_2.Points), center=list_item_2, point_b=sub_list.List)  # -> simplify(moved)
point = Point(split_list_2.ListA)
min_max_5 = MinMax(Number=flatten(deck_python.Distance))  # -> Minimum, Maximum
division_4 = Division(A=deck_python.Distance, B=min_max_5.Minimum)  # -> simplify(Result)
cluster_2 = Cluster_2(A=cluster.beam_2, number=division_4)
cluster_3 = Cluster_3(value=deck_horizontal_curviture, domain_start="0", domain_end=cluster_2)
multiplication_3 = Multiplication(A=cluster_3, B=division_4)
min_max_6 = MinMax(Number=flatten(multiplication_3))  # -> Minimum, Maximum
construct_domain_11 = ConstructDomain(DomainStart=0, DomainEnd=min_max_6.Maximum)
construct_domain_12 = ConstructDomain(DomainStart=min_max_6.Minimum, DomainEnd=min_max_6.Maximum)
remap_numbers_3 = RemapNumbers(Value=multiplication_3, Source=construct_domain_12, Target=construct_domain_11)  # -> simplify(Mapped), Clipped
evaluate_curve = EvaluateCurve(Curve=bezier_span.Curve, Parameter=0.01)  # -> Point, expr("-x", unitize(Tangent)), Angle
unit_x_2 = UnitX(Factor=remap_numbers_3.Mapped)
multiplication_4 = Multiplication(A=evaluate_curve.Tangent, B=deck_vertical_curviture)
bezier_span_2 = BezierSpan(StartPoint=transform_2, StartTangent=unit_x_2, EndPoint=point, EndTangent=multiplication_4)  # -> Curve, Length, Domain
mirror_3 = Mirror(Geometry=bezier_span_2.Curve, Plane=graft(plane_origin))  # -> simplify(Geometry), Transform
join_curves_2 = JoinCurves(Curves=[mirror_3.Geometry, bezier_span_2.Curve], Preserve=False)  # -> simplify(Curves)
deck = Ribs(center=list_item_2, geometry=join_curves_2, point_a=sub_list.List, point_b=list_item_2)

cluster_4 = Cluster_3(value=cockpit_width, domain_start="0", domain_end=expr("x-4", cluster.beam_2))
project_2 = Project(Geometry=peak.Geometry, Plane=PlaneXY(0, 0, 0))  # -> Geometry, Transform
vector_xyz_4 = VectorXYZ(XComponent=cockpit_width_x, YComponent=expr("x/2", cluster_4), ZComponent=0)  # -> Vector, Length
vector_xyz_5 = VectorXYZ(XComponent=cockpit_longitudinal_start, YComponent=0, ZComponent=0)  # -> Vector, Length
peak_2 = Move(Geometry=project_2.Geometry, Motion=vector_xyz_5.Vector)  # -> Geometry, Transform
cluster_5 = Cluster_3(value=cockpit_length, domain_start=cockpit_longitudinal_start, domain_end=expr("3*x", peak_2.Geometry))
vector_xyz_6 = VectorXYZ(XComponent=cluster_5, YComponent=0, ZComponent=0)  # -> Vector, Length
peak_3 = Move(Geometry=curve_middle, Motion=vector_xyz_4.Vector)  # -> Geometry, Transform
peak_4 = Move(Geometry=curve_middle, Motion=vector_xyz_6.Vector)  # -> Geometry, Transform
distance = Distance(PointA=peak_2.Geometry, PointB=peak_4.Geometry)
unit_x_3 = UnitX(Factor=expr("-x", forward_cockpit_curvature))
unit_y_2 = UnitY(Factor=cockpit_front_curvature)
unit_y_3 = UnitY(Factor=cockpit_back_curvature)
bezier_span_3 = BezierSpan(StartPoint=peak_2.Geometry, StartTangent=unit_y_2, EndPoint=peak_3.Geometry, EndTangent=unit_x_3)  # -> Curve, Length, Domain
evaluate_curve_2 = EvaluateCurve(Curve=bezier_span_3.Curve, Parameter=0.99)  # -> Point, unitize(Tangent), Angle
multiplication_5 = Multiplication(A=evaluate_curve_2.Tangent, B=rear_cockpit_curvature)
bezier_span_4 = BezierSpan(StartPoint=peak_3.Geometry, StartTangent=multiplication_5, EndPoint=peak_4.Geometry, EndTangent=unit_y_3)  # -> Curve, Length, Domain
join_curves_3 = JoinCurves(Curves=[bezier_span_3.Curve, bezier_span_4.Curve], Preserve=False)
mirror_4 = Mirror(Geometry=join_curves_3, Plane=Plane(origin=(0, 0, 0), x=(0, 0, 1), y=(1, 0, 0)))  # -> Geometry, Transform
join_curves_4 = JoinCurves(Curves=[join_curves_3, mirror_4.Geometry], Preserve=False)

beam_x_coordinate_in = Panel(cluster.beam_x_coordinate_2)
rib_spacing = Panel(list_item)
beam_placement = Panel(slide_within_domain)
beam_width_in = Panel(cluster.beam_2)
bow_width = Panel(slide_within_domain_3)
stern_width = Panel(slide_within_domain_2)
cockpit_width_2 = Panel(cluster_4)
cockpit_length_2 = Panel(distance)

split_list_4 = SplitList(List=reference_box_2.Geometry, Index=1)  # -> ListA, ListB
meshcorners = MeshCorners(Mesh=split_list_4.ListA, Angle=2.35619449)
meshcorners_2 = MeshCorners(Mesh=split_list_4.ListB, Angle=2.35619449)
cull_pattern_2 = CullPattern(List=meshcorners_2, CullPattern=invert([True, False]))
cull_pattern_3 = CullPattern(List=meshcorners, CullPattern=[True, False])
split_list_5 = SplitList(List=cull_pattern_3, Index=1)  # -> ListA, ListB
split_list_6 = SplitList(List=cull_pattern_2, Index=1)  # -> ListA, ListB
unit_y_4 = UnitY(Factor=1)
unit_y_5 = UnitY(Factor=1)
subtraction_3 = Subtraction(A=split_list_5.ListA, B=unit_y_4)
subtraction_4 = Subtraction(A=split_list_6.ListB, B=unit_y_5)
vector_2pt_3 = Vector2Pt(PointA=split_list_5.ListA, PointB=split_list_5.ListB, Unitize=True)  # -> Vector, Length
vector_2pt_4 = Vector2Pt(PointA=split_list_5.ListA, PointB=subtraction_3, Unitize=False)  # -> Vector, Length
vector_2pt_5 = Vector2Pt(PointA=split_list_6.ListB, PointB=split_list_6.ListA, Unitize=True)  # -> Vector, Length
vector_2pt_6 = Vector2Pt(PointA=split_list_6.ListB, PointB=subtraction_4, Unitize=False)  # -> Vector, Length
angle_2 = Angle(VectorA=vector_2pt_3.Vector, VectorB=vector_2pt_4.Vector)  # -> Angle, Reflex
angle_3 = Angle(VectorA=vector_2pt_5.Vector, VectorB=vector_2pt_6.Vector)  # -> Angle, Reflex
unit_z_2 = UnitZ(Factor=1)
unit_z_3 = UnitZ(Factor=1)
multiplication_6 = Multiplication(A=angle_2.Angle, B=bow_vertical_curviture_direction)
multiplication_7 = Multiplication(A=angle_3.Angle, B=stern_vertical_curviture_direction)
rotate_2 = Rotate(Vector=vector_2pt_3.Vector, Axis=unit_z_2, Angle=expr("-x", multiplication_6))
rotate_3 = Rotate(Vector=vector_2pt_5.Vector, Axis=unit_z_3, Angle=multiplication_7)
unit_vector_2 = UnitVector(Vector=rotate_2)
unit_vector_3 = UnitVector(Vector=rotate_3)
unit_x_4 = UnitX(Factor=expr("-x", bow_vertical_curviture_magnitude_2))
unit_x_5 = UnitX(Factor=stern_vertical_curviture_magnitude)
multiplication_8 = Multiplication(A=unit_vector_2, B=bow_vertical_curviture_magnitude)
multiplication_9 = Multiplication(A=unit_vector_3, B=stern_vertical_curviture_magnitude_2)
list_item_3 = ListItem(List=meshcorners, Index=3, Wrap=True)
list_item_4 = ListItem(List=meshcorners_2, Index=0, Wrap=True)
bezier_span_5 = BezierSpan(StartPoint=split_list_5.ListA, StartTangent=multiplication_8, EndPoint=split_list_5.ListB, EndTangent=unit_x_4)  # -> Curve, Length, Domain
bezier_span_6 = BezierSpan(StartPoint=split_list_6.ListB, StartTangent=multiplication_9, EndPoint=split_list_6.ListA, EndTangent=unit_x_5)  # -> Curve, Length, Domain
line_2 = Line(StartPoint=split_list_5.ListA, EndPoint=list_item_3)
line_3 = Line(StartPoint=list_item_3, EndPoint=split_list_5.ListB)
line_4 = Line(StartPoint=split_list_6.ListA, EndPoint=list_item_4)
line_5 = Line(StartPoint=list_item_4, EndPoint=split_list_6.ListB)
bow = Bow(geometry=bezier_span_5.Curve, center=split_list_5.ListB, point_a=split_list_5.ListB, point_b=first_last.FirstValue)
bow_2 = Bow(geometry=bezier_span_6.Curve, center=split_list_6.ListA, point_a=split_list_6.ListA, point_b=first_last.LastValue)
join_curves_5 = JoinCurves(Curves=[line_2, line_3, bezier_span_5.Curve], Preserve=False)  # -> simplify(flatten(Curves))
join_curves_6 = JoinCurves(Curves=[line_4, line_5, bezier_span_6.Curve], Preserve=False)  # -> simplify(flatten(Curves))
merge_5 = Merge(Data1=bow, Data2=sub_curve, Data3=bow_2)  # -> flatten(Result)
keel = JoinCurves(Curves=merge_5, Preserve=False)

strong_back_text = StrongBackText(motion=sub_list.List, geometry=hull_reference)  # -> group_2, geometry_2
join_curves_7 = JoinCurves(Curves=[join_curves, join_curves_2], Preserve=False)  # -> simplify(flatten(Curves))
construct_point_14 = ConstructPoint(XCoordinate=0, YCoordinate=0, ZCoordinate=0)
construct_point_15 = ConstructPoint(XCoordinate="96", YCoordinate="48", ZCoordinate=0)
merge_6 = Merge(
    Data1=simplify(graft(join_curves_7)),
    Data2=simplify(graft(strong_back_text.geometry_2)),
    Data3=simplify(graft(strong_back_text.group_2)))
rectangle_2pt_3 = Rectangle2Pt(Plane=PlaneXY(0, 0, 0), PointA=construct_point_14, PointB=construct_point_15, Radius=0)  # -> Rectangle, Length
merge_7 = Merge(Data1=join_curves_7, Data2=join_curves_5, Data3=join_curves_6)
area = Area(Geometry=merge_7)  # -> Area, Centroid
group = Group(Objects=merge_6)
area_2 = Area(Geometry=rectangle_2pt_3.Rectangle)  # -> Area, Centroid
mass_addition = MassAddition(Input=area.Area)  # -> Result, PartialResults
merge_8 = Merge(Data1=flatten(group), Data2=join_curves_5, Data3=join_curves_6)  # -> flatten(Result)
division_5 = Division(A=mass_addition.Result, B=area_2.Area)
round = Round(Number=division_5)  # -> Nearest, Floor, flatten(Ceiling)
duplicate_data = DuplicateData(Data="96", Number=round.Ceiling, Order=True)  # -> simplify(flatten(Data))
mass_addition_2 = MassAddition(Input=duplicate_data)  # -> Result, graft(PartialResults)
vector_xyz_7 = VectorXYZ(XComponent=expr("x-96", mass_addition_2.PartialResults), YComponent="-288", ZComponent=0)  # -> Vector, Length
move_3 = Move(Geometry=rectangle_2pt_3.Rectangle, Motion=vector_xyz_7.Vector)  # -> flatten(Geometry), Transform
transform_3 = Transform(Geometry=merge_8)

split_list_7 = SplitList(List=flatten(move.Geometry), Index=1)  # -> ListA, ListB
split_list_8 = SplitList(List=flatten(move.Geometry), Index=1)  # -> simplify(flatten(ListA)), flatten(ListB)
extrude_2 = Extrude(Base=join_curves_4, Direction=vector_xyz_2.Vector)
merge_9 = Merge(Data1=interpolate_2.Curve, Data2=split_list_8.ListA)
merge_10 = Merge(Data1=interpolate_2.Curve, Data2=split_list_8.ListB)
merge_11 = Merge(Data1=keel, Data2=split_list_7.ListA)
merge_12 = Merge(Data1=keel, Data2=split_list_7.ListB)
network_surface = NetworkSurface(CurvesU=merge_11, CurvesV=flatten(curve), Continuity=2)
network_surface_2 = NetworkSurface(CurvesU=merge_12, CurvesV=flatten(curve), Continuity=2)
network_surface_3 = NetworkSurface(CurvesU=merge_9, CurvesV=flatten(deck), Continuity=2)
network_surface_4 = NetworkSurface(CurvesU=merge_10, CurvesV=flatten(deck), Continuity=2)
brep_join = BrepJoin(Breps=[network_surface, network_surface_2])  # -> Breps, Closed
brep_join_2 = BrepJoin(Breps=[network_surface_3, network_surface_4])  # -> Breps, Closed
project_3 = Project(Curve=join_curves_4, Brep=brep_join_2.Breps, Direction=Vector(0, 0, 1))
split_brep = SplitBrep(Brep=brep_join_2.Breps, Cutter=extrude_2)
list_item_5 = ListItem(List=split_brep, Index=0, Wrap=True)
brep_join_3 = BrepJoin(Breps=flatten([brep_join_2.Breps, brep_join.Breps]))  # -> Breps, Closed
volume = Volume(Geometry=brep_join_3.Breps)  # -> Volume, Centroid

division_6 = Division(A=X, B=cluster.beam_x_coordinate_2)
rib_spacing_2 = Integer(flatten(custom_int_domain))
rib_count = Integer(flatten(python_moduls.Count))
volume_2 = Text(flatten(volume.Volume))
length_5 = Text(flatten(length))
beam_2 = Text(flatten(cluster.beam_2))
text = Text(flatten(division_6))
round_to_decimal_place = RoundToDecimalPlace(NumberX=beam_2, DecimalPlace=2, RoundType=0)  # -> Rounded, Difference
round_to_decimal_place_2 = RoundToDecimalPlace(NumberX=volume_2, DecimalPlace=2, RoundType=0)  # -> Rounded, Difference
round_to_decimal_place_3 = RoundToDecimalPlace(NumberX=text, DecimalPlace=2, RoundType=0)  # -> Rounded, Difference
panel_11 = Panel("""Length (ft): 
Beam (in): 
L/B Ratio: 
Volume (in3): 
Number of Ribs: 
Ribs Spacing (in): """)
merge_13 = Merge(
    Data1=length_5,
    Data2=round_to_decimal_place.Rounded,
    Data3=round_to_decimal_place_3.Rounded,
    Data4=round_to_decimal_place_2.Rounded,
    Data5=rib_count,
    Data6=rib_spacing_2)
list_length_3 = ListLength(List=merge_13)
series_3 = Series(Start=40, Step=Slider(23, range=10..60), Count=list_length_3)
concatenate = Concatenate(FragmentA=panel_11, FragmentB=merge_13)
construct_point_16 = ConstructPoint(XCoordinate=10, YCoordinate=series_3, ZCoordinate=0)
render_text_to_screen = RenderTextToScreen(Text=concatenate, Location=construct_point_16, Size=12, Color=RGB(255, 255, 255), m_scWithvp=False)

brep_join_4 = BrepJoin(Breps=[brep_join.Breps, list_item_5])  # -> Breps, Closed

# ==== cluster Subdivide
curve = ClusterInput()
length = Length(Curve=curve)
bow = ClusterInput()
stern = ClusterInput()
division = Division(A=bow, B=length)
division_2 = Division(A=stern, B=length)
subtraction = Subtraction(A=1, B=division)
start = ClusterOutput(division_2)
end = ClusterOutput(subtraction)

# ==== cluster HullReference
A = ClusterInput()
division = Division(A=A, B=2)
y_coordinate = ClusterInput()
construct_point = ConstructPoint(XCoordinate=expr("-x", division), YCoordinate=y_coordinate, ZCoordinate=0)
construct_point_2 = ConstructPoint(XCoordinate=division, YCoordinate=0, ZCoordinate=0)
rectangle_2pt = Rectangle2Pt(Plane=PlaneXY(0, 0, 0), PointA=construct_point_2, PointB=construct_point, Radius=0)  # -> Rectangle, Length
rectangle = ClusterOutput(rectangle_2pt.Rectangle)

# ==== cluster DeckReference
y_coordinate = ClusterInput()
A = ClusterInput()
division = Division(A=A, B=2)
y_coordinate_2 = ClusterInput()
construct_point = ConstructPoint(XCoordinate=expr("-x", division), YCoordinate=y_coordinate_2, ZCoordinate=0)
construct_point_2 = ConstructPoint(XCoordinate=division, YCoordinate=y_coordinate, ZCoordinate=0)
rectangle_2pt = Rectangle2Pt(Plane=PlaneXY(0, 0, 0), PointA=construct_point_2, PointB=construct_point, Radius=0)  # -> Rectangle, Length
rectangle = ClusterOutput(rectangle_2pt.Rectangle)

# ==== cluster Transform
unit_z = UnitZ(Factor=1)
unit_x = UnitX(Factor=1)
point_b = ClusterInput()
geometry = ClusterInput()
center = ClusterInput()
rotate_3d = Rotate3D(Geometry=geometry, Angle=1.570796327, Center=center, Axis=unit_z)  # -> Geometry, Transform
rotate_3d_2 = Rotate3D(Geometry=rotate_3d.Geometry, Angle=-1.570796327, Center=center, Axis=unit_x)  # -> Geometry, Transform
move_to_point = MoveToPoint(Geometry=rotate_3d_2.Geometry, PointA=center, PointB=graft(point_b))  # -> Moved, Vector, Transform
moved = ClusterOutput(move_to_point.Moved)

# ==== cluster Cluster
geometry = ClusterInput()
bounding_rectangle = BoundingRectangle(Geometry=flatten(geometry), Plane=PlaneXY(0, 0, 0), Axis=0, Slide=0, Union=True)  # -> Bounding, DimensionX, DimensionY
explode = Explode(Curve=bounding_rectangle.Bounding, Recursive=True)  # -> Segments, Vertices
mass_addition = MassAddition(Input=bounding_rectangle.DimensionY)  # -> Result, PartialResults
list_item = ListItem(List=explode.Segments, Index=[0, 2], Wrap=True)
curve_b = ClusterInput()
beam = Number(mass_addition.Result)
curve_curve = CurveCurve(CurveA=list_item, CurveB=curve_b)  # -> simplify(Points), ParamsA, ParamsB
beam_2 = ClusterOutput(beam)
points = ClusterOutput(curve_curve.Points)
deconstruct = Deconstruct(Point=curve_curve.Points)  # -> flatten(XComponent), YComponent, ZComponent
list_item_2 = ListItem(List=deconstruct.XComponent, Index=0, Wrap=True)
beam_x_coordinate = Number(list_item_2)
beam_x_coordinate_2 = ClusterOutput(beam_x_coordinate)

# ==== cluster DomainPercentage
domain_end = ClusterInput()
domain_start = ClusterInput()
value = ClusterInput()
construct_domain = ConstructDomain(DomainStart=domain_start, DomainEnd=domain_end)
remap_numbers = RemapNumbers(Value=value, Source=Domain(0, 1), Target=construct_domain)  # -> Mapped, Clipped
mapped = ClusterOutput(remap_numbers.Mapped)

# ==== cluster Ribs
center = ClusterInput()
unit_z = UnitZ(Factor=1)
unit_x = UnitX(Factor=1)
geometry = ClusterInput()
point_a = ClusterInput()
point_b = ClusterInput()
move_to_point = MoveToPoint(Geometry=geometry, PointA=graft(point_a), PointB=point_b)  # -> Moved, Vector, Transform
rotate_3d = Rotate3D(Geometry=move_to_point.Moved, Angle=1.570796327, Center=center, Axis=unit_x)  # -> Geometry, Transform
rotate_3d_2 = Rotate3D(Geometry=rotate_3d.Geometry, Angle=-1.570796327, Center=center, Axis=unit_z)  # -> Geometry, Transform
geometry_2 = ClusterOutput(rotate_3d_2.Geometry)

# ==== cluster Bow
unit_x = UnitX(Factor=1)
geometry = ClusterInput()
center = ClusterInput()
point_a = ClusterInput()
point_b = ClusterInput()
rotate_3d = Rotate3D(Geometry=geometry, Angle=1.570796327, Center=center, Axis=unit_x)  # -> Geometry, Transform
move_to_point = MoveToPoint(Geometry=rotate_3d.Geometry, PointA=point_a, PointB=point_b)  # -> Moved, Vector, Transform
moved = ClusterOutput(move_to_point.Moved)

# ==== cluster Cluster_2
A = ClusterInput()
number = ClusterInput()
division = Division(A=A, B=2)
min_max = MinMax(Number=flatten(number))  # -> Minimum, Maximum
division_2 = Division(A=division, B=min_max.Maximum)  # -> simplify(Result)
result = ClusterOutput(division_2)

# ==== cluster Cluster_3
domain_start = ClusterInput()
domain_end = ClusterInput()
construct_domain = ConstructDomain(DomainStart=domain_start, DomainEnd=domain_end)
value = ClusterInput()
remap_numbers = RemapNumbers(Value=value, Source=Domain(0, 1), Target=construct_domain)  # -> Mapped, Clipped
mapped = ClusterOutput(remap_numbers.Mapped)

# ==== cluster CustomIntDomain
domain_start = ClusterInput()
domain_end = ClusterInput()
construct_domain = ConstructDomain(DomainStart=domain_start, DomainEnd=domain_end)
value = ClusterInput()
remap_numbers = RemapNumbers(Value=value, Source=Domain(0, 1), Target=construct_domain)  # -> Mapped, Clipped
round = Round(Number=remap_numbers.Mapped)  # -> Nearest, Floor, Ceiling
nearest = ClusterOutput(round.Nearest)

# ==== cluster StrongBackText
geometry = ClusterInput()
center = Center(Geometry=geometry)  # -> Center, Dimension
vector_xyz = VectorXYZ(XComponent=expr("-x", "1"), YComponent="0", ZComponent=0)  # -> Vector, Length
vector_xyz_2 = VectorXYZ(XComponent="1", YComponent="3", ZComponent=0)  # -> Vector, Length
construct_point = ConstructPoint(XCoordinate=0, YCoordinate=expr("x+1", "3"), ZCoordinate=0)
move = Move(Geometry=center.Center, Motion=vector_xyz_2.Vector)  # -> Geometry, Transform
move_2 = Move(Geometry=center.Center, Motion=vector_xyz.Vector)  # -> Geometry, Transform
number_slider = Slider(1.25, range=0..2)
addition = Addition(A=center.Center, B=construct_point)
motion = ClusterInput()
item_index = ItemIndex(List=motion, Item=motion)  # -> simplify(graft(Index))
strong_back = Rectangle2Pt(Plane=PlaneXY(0, 0, 0), PointA=move.Geometry, PointB=move_2.Geometry, Radius=0)  # -> Rectangle, Length
text = Text(item_index)
move_3 = Move(Geometry=<missing>, Motion=graft(motion))  # -> simplify(Geometry), Transform
move_4 = Move(Geometry=graft(strong_back.Rectangle), Motion=motion)  # -> simplify(Geometry), Transform
group = Group(Objects=move_3.Geometry)  # -> flatten(Group)
geometry_2 = ClusterOutput(move_4.Geometry)
group_2 = ClusterOutput(group)
